# Dynamo graph copyViewsFromDocument.dyn (Dynamo 1.2.1.3083)

# group: Opens document in memory, but not visible
file_path = Filename("..\insertViewsFromFile\sourceFile.rvt")
backgroundOpen = Custom[Document.BackgroundOpen](filePath=file_path)  # This will open the input Revit files in the background.

# group: Collects drafting views from chosen document
element_types = ElementTypes("ViewDrafting")
all_elements_of_type_in_document = Custom[All Elements of Type in Document](document=backgroundOpen, element_type=element_types)  # All elements of given type in specified document. This works for unopened files and for linked documents.
flatten = Flatten(all_elements_of_type_in_document)

# group: This is a modified node from Dimitar (spring nodes)
python_script = Python(IN[0]=flatten, IN[1]=backgroundOpen)
# ---------- python_script.python (35 lines) ----------
#Copyright(c) 2016, Dimitar Venkov
# @5devene, dimitar.ven@gmail.com

import clr

clr.AddReference("RevitServices")
import RevitServices
from RevitServices.Persistence import DocumentManager
doc = IN[1]

clr.AddReference("RevitAPI")
from Autodesk.Revit.DB import FilteredElementCollector

clr.AddReference("RevitNodes")
import Revit
clr.ImportExtensions(Revit.Elements)

def tolist(obj1):
	if hasattr(obj1,"__iter__"): return obj1
	else: return [obj1]
def output1(l1):
	if len(l1) == 1: return l1[0]
	else: return l1

views = UnwrapElement(tolist(IN[0]))
elements = []

for i in xrange(len(views)):
	fec = FilteredElementCollector(doc, views[i].Id).WhereElementIsNotElementType().GetElementIterator()
	fec.Reset()
	view_el = []
	while fec.MoveNext():
		view_el.append(fec.Current.ToDSType(True))
	elements.append(view_el)
OUT = output1(elements)
# ----------------------------------------
code_block = CodeBlock { 0; }
removeItemAtIndex = List.RemoveItemAtIndex(list=python_script, indices=code_block, lacing=Longest)

# group: Copies the views into your current document.
copyFromDocument = Custom[Element.CopyFromDocument](elements=flatten, document=backgroundOpen)  # This node allows you to copy elements from a specific document to your current document.

copyFromViewToView = Custom[Element.CopyFromViewToView](elements=removeItemAtIndex, sourceView=flatten, destinationView=copyFromDocument, lacing=Longest)  # This will copy elements from view to view.
